# Grasshopper definition BirdFlocking_GH_Simon.gh (Grasshopper 1.0.7)

panel = Panel("C:\Users\simon\Dropbox\ITECH 2018-2019\ComputationalDesign\Assignments\FinalAssignment\CompDesing_Birdflocking\BirdFlocking\BirdFlocking.py")
pt = Point(Point(0.2636340412, -66.99767909, 26.5460533))
file = ReadFile(File=panel, PerLineParse=False)
tag = TextTag(Location=pt, Text="Maultaschen")
timer = Timer(TimerInterval=20, Target=python)  # disabled
python = GhPythonScript(
    Code=file,
    IReset=Button(),
    IEnabled=Toggle(False),
    IAgentCount=Slider(50, range=0..100),
    IFoodStrength=Slider(10.91, range=0..50),
    IFoodSource=pt,
    ISeparationStrength=Slider(2.49, range=0..10),
    ISeparationDistance=Slider(3.72, range=0..10),
    IDetectonDistance=Slider(11, range=0..100),
    IWindSpeedX=Slider(6.5, range=0..100))  # -> Out, OHistory, OPositions, OPositions2
pt_2 = Point(python.OPositions)
crv = Curve(python.OHistory)
preview = CustomPreview(Geometry=python.OPositions2, Material=ColourSwatch(SwatchColor=RGB(210, 250, 64)))
