# Grasshopper definition BirdFlocking_GH_v01_ts.gh (Grasshopper 1.0.7)

vec = VectorXYZ(
    XComponent=Slider(0.1, range=-100..100),
    YComponent=Slider(-23.4, range=-100..100),
    ZComponent=Slider(0, range=-100..100))  # -> Vector, Length
path = FilePath("C:\Users\Tim Stark\Desktop\ITECH_CompDesign\FinalAssignment\BirdFlocking\BirdFlocking.py")
pt = Point(Point(446.0288227, 127.8417792, 120.2952428))
file = ReadFile(File=path, PerLineParse=False)
# NEEDS TO BE RENAMED
# decide for test or not
tag = TextTag(Location=pt, Text="Maultaschen")
panel = Panel("""40
20""")
panel_2 = Panel("""3
2""")
panel_3 = Panel(""".9
.9""")
crv = Curve([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])
brep = Brep([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])
timer = Timer(TimerInterval=20, Target=python)
python = GhPythonScript(
    Code=file,
    IReset=Button(),
    IEnabled=Toggle(False),
    IAgentCount=Slider(52, range=0..1100),
    IAgentVelocity=".03",
    ISpeed=Slider(1.74, range=0..2),
    IFoodStrength=Slider(7.22, range=0..50),
    IFoodSource=pt,
    ISeparationStrength=Slider(35.99, range=0..70),
    ISeparationDistance=Slider(18.95, range=0..50),
    IDetectonDistance=Slider(10.96, range=0..100),
    IWindSpeed=vec.Vector,
    ICollideStrength=Slider(20, range=0..20),
    IObstacleBreps=brep,
    IUpliftStrength=panel_2,
    IUpliftCrvs=crv,
    IUpliftRadius=panel,
    IUpliftRevolveStrength=panel_3,
    IPredatorCount=Slider(3, range=0..10),
    IPredatorVelocity=".2",
    IPredatorRadius=Slider(4, range=0..100),
    IPredatorSpeed=Slider(3, range=1..10))  # -> Out, OBirdHistory, OBirdPositions, OPredatorHistory, OPredatorPositions
sph = Sphere(Base=python.OPredatorPositions, Radius=2)
panel_4 = Panel(python.Out)
preview = CustomPreview(Geometry=sph, Material="255, 65, 77")
preview_2 = CustomPreview(Geometry=python.OPredatorHistory, Material="255, 65, 77")
preview_3 = CustomPreview(Geometry=python.OBirdHistory, Material="0, 111, 140")
preview_4 = CustomPreview(Geometry=python.OBirdPositions, Material="0, 111, 140")
