# Grasshopper definition BirdFlocking_GH_v02_ts.gh (Grasshopper 1.0.7)

python = GhPythonScript()  # -> out, a
# ---------- python: Python ----------
import Rhino.Geometry as rg 

rg.NurbsCurve.Create(
# ---------- end python ----------
vec = VectorXYZ(
    XComponent=Slider(0.1, range=-100..100),
    YComponent=Slider(-59.1, range=-100..100),
    ZComponent=Slider(0, range=-100..100))  # -> Vector, Length
path = FilePath("C:\Users\Tim Stark\Desktop\ITECH_CompDesign\FinalAssignment\BirdFlocking\BirdFlocking.py")

opacity = WindowOpacity(A=Slider(0.5, range=0..1))

pt = Point(Point(446.0288227, 127.8417792, 120.2952428))
file = ReadFile(File=path, PerLineParse=False)
tag = TextTag(Location=pt, Text="Maultaschen")
panel = Panel("""40
20""")
panel_2 = Panel("""3
2""")
panel_3 = Panel(""".9
.9""")
# NEEDS TO BE RENAMED
# decide for test or not
brep = Brep([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])
brep_2 = Brep([<brep referenced from the Rhino model> x6])
crv = Curve([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])
timer = Timer(TimerInterval=20, Target=python_2)
python_2 = GhPythonScript(
    Code=file,
    IReset=Button(),
    IEnabled=Toggle(False),
    IAgentCount=Slider(40, range=0..1100),
    IAgentVelocity=".03",
    ISpeed=Slider(1, range=0..2),
    IFoodStrength=Slider(7.22, range=0..50),
    IFoodSource=pt,
    ISeparationStrength=Slider(35.99, range=0..70),
    ISeparationDistance=Slider(18.95, range=0..50),
    IDetectonDistance=Slider(23.66, range=0..100),
    IWindSpeed=vec.Vector,
    ICollideStrength=Slider(20, range=0..20),
    IObstacleBreps=brep,
    IUpliftStrength=panel_2,
    IUpliftCrvs=crv,
    IUpliftRadius=panel,
    IUpliftRevolveStrength=panel_3,
    IPredatorCount=Slider(4, range=0..10),
    IPredatorVelocity=".1",
    IPredatorRadius=Slider(48, range=0..100),
    IPredatorSpeed=Slider(1.2, range=1..10))  # -> Out, OBirdHistory, OBirdPositions, OBirdTimeToDeath, OPredatorHistory, OPredatorPositions, OPredatorTag
sph = Sphere(Base=python_2.OPredatorPositions, Radius=2)
panel_4 = Panel(python_2.Out)
tag_2 = TextTag(Location=python_2.OPredatorPositions, Text=python_2.OPredatorTag, Colour="orange")
tag_3 = TextTag(Location=python_2.OBirdPositions, Text=python_2.OBirdTimeToDeath, Colour="255, 65, 77")
preview = CustomPreview(Geometry=sph, Material="255, 65, 77")
preview_2 = CustomPreview(Geometry=python_2.OPredatorHistory, Material="255, 65, 77")
preview_3 = CustomPreview(Geometry=python_2.OBirdHistory, Material="0, 111, 140")
preview_4 = CustomPreview(Geometry=python_2.OBirdPositions, Material="0, 111, 140")

# ==== cluster WindowOpacity
A = ClusterInput()
c_script = CSharpScript(A=A)  # -> out, e; inputs A: Double
# ---------- c_script: C# ----------
    System.Windows.Forms.Form form = Instances.DocumentEditor;


    A = Math.Min(A, 1.0);
    A = Math.Max(A, 0.1);

    form.Opacity = A;
# ---------- end c_script ----------
